# Grasshopper definition 01-voxelate-bunny.gh (Grasshopper 1.0.7)
# plug-ins: VoxelTools

grid_orientation = Slider(0, range=0..90)
voxel_size = Slider(5, range=0..10)
# Example 1: Voxelate closed meshes
mesh = Mesh(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)
pln = Plane(PlaneXY(0, 0, 0))
prot = RotatePlane(Plane=pln, Angle=degrees(grid_orientation))
# Define the bounding box & cell size
bbox = BoundingBox(Content=mesh, Plane=prot, UnionBox=True)  # -> Box, Box_2
voxcreate = CreateVoxelGrid(BoundingBox=bbox.Box, SizeX=voxel_size, SizeY=voxel_size, SizeZ=voxel_size)
# Voxelate geometry
voxgeo = VoxelateGeometry(Geometry=mesh, VoxelGridParam=voxcreate, Distance=0)
