# Grasshopper definition 02-voxelate-open-meshes.gh (Grasshopper 1.0.7)
# plug-ins: VoxelTools

# Example 2: Voxelate open meshes
mesh = Mesh(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)
voxel_size = Slider(2, range=0..10)
# Define closest point for voxelization
voxelation_distance = Slider(1, range=0..10)
# Define the bounding box & cell size
bbox = BoundingBox(Content=mesh, Plane=PlaneXY(0, 0, 0), UnionBox=True)  # -> Box, Box_2
voxcreate = CreateVoxelGrid(BoundingBox=bbox.Box, SizeX=voxel_size, SizeY=voxel_size, SizeZ=voxel_size)
# Voxelate geometry
voxgeo = VoxelateGeometry(Geometry=mesh, VoxelGridParam=voxcreate, Distance=voxelation_distance)
