# Grasshopper definition 03-voxelate-cylinder.gh (Grasshopper 1.0.7)
# plug-ins: VoxelTools

# ----
# Create grid
voxelsize = Slider(1, range=0..10)
height = Slider(50, range=0..200)
# Example 3: Voxelate closed brep
X = Slider(40, range=0..100)
domain_box = DomainBox(Base=PlaneXY(0, 0, 0), X=X, Y=X, Z=height)
create_voxelgrid = CreateVoxelGrid(BoundingBox=domain_box, SizeX=voxelsize, SizeY=voxelsize, SizeZ=voxelsize)

base = Base(PlaneXY(20, 20, 0))
cylinder = Cylinder(Base=base, Radius=expr("x/2", X), Length=height)
voxelategeometry = VoxelateGeometry(Geometry=cylinder, VoxelGrid=create_voxelgrid, Distance=Slider(3, range=0..100))
voxelgrid_to_mesh_hull = VoxelGridToMeshHull(VoxelGrid=voxelategeometry, FakeShadow=True)  # -> Mesh, X, X_2, Y, Y_2, Z, Z_2
