# Grasshopper definition 03-voxelate-tower.gh (Grasshopper 1.0.7)
# plug-ins: VoxelTools

# ----
# Bottom Curve
rotation_top = Slider(100, range=0..100)
radi = Slider(18, range=0..100)
number_of_sides = Slider(3, range=0..10)
xy_plane = XYPlane(Origin=Point(20, 20, 40))
rotate_plane = RotatePlane(Plane=xy_plane, Angle=degrees(rotation_top))
polygon = Polygon(Plane=rotate_plane, Radius=radi, Segments=number_of_sides, FilletRadius=0)  # -> Polygon, Length

# ----
# Top Curve
rotation_bottom = Slider(0, range=0..100)
xy_plane_2 = XYPlane(Origin=Point(20, 20, 0))
rotate_plane_2 = RotatePlane(Plane=xy_plane_2, Angle=degrees(rotation_bottom))
polygon_2 = Polygon(Plane=rotate_plane_2, Radius=radi, Segments=number_of_sides, FilletRadius=0)  # -> Polygon, Length

# ----
# Create grid
voxelsize = Slider(1, range=0..10)
height = Slider(40, range=0..200)
# Example 3: Voxelate closed brep
X = Slider(40, range=0..100)
domain_box = DomainBox(Base=PlaneXY(0, 0, 0), X=X, Y=X, Z=height)
create_voxelgrid = CreateVoxelGrid(BoundingBox=domain_box, SizeX=voxelsize, SizeY=voxelsize, SizeZ=voxelsize)

loft = Loft(
    Curves=[polygon_2.Polygon, polygon.Polygon],
    Options={Adjust=False, Closed=False, LoftEnds=0, LoftSimp=0, LoftType=0, Rebuild=10, Refit=0.01})
cap_holes = CapHoles(Brep=loft)
voxelategeometry = VoxelateGeometry(Geometry=cap_holes, VoxelGrid=create_voxelgrid, Distance=0)
