# Grasshopper definition 04-voxelate-cylinder.gh (Grasshopper 1.0.7)
# plug-ins: VoxelTools

R = Slider(20, range=0..100)
attractor_distance = Slider(0, range=0..20)

# ----
# Create grid
voxelsize = Slider(1, range=0..10)
height = Slider(40, range=0..200)
# Example 4: Voxelate surface / brep with attractor distance
X = Slider(40, range=0..100)
domain_box = DomainBox(Base=PlaneXY(0, 0, 0), X=X, Y=X, Z=height)
create_voxelgrid = CreateVoxelGrid(BoundingBox=domain_box, SizeX=voxelsize, SizeY=voxelsize, SizeZ=voxelsize)

L = Slider(40, range=0..100)
cylinder = Cylinder(Base=PlaneXY(20, 20, 0), Radius=R, Length=L)
voxelategeometry = VoxelateGeometry(Geometry=cylinder, VoxelGrid=create_voxelgrid, Distance=attractor_distance)
mesh = Mesh(voxelategeometry)
