# Grasshopper definition 05-voxelate-curve.gh (Grasshopper 1.0.7)
# plug-ins: VoxelTools

# ----
# Create spiral curve
number_slider = Slider(34, range=0..100)
number_slider_2 = Slider(10, range=0..10)
R = Slider(14, range=0..100)
attractor_distance = Slider(20, range=0..20)
L = Slider(40, range=0..100)
division = Division(A=1, B=number_slider)
division_2 = Division(A=1, B=number_slider_2)
series = Series(Start=0, Step=division, Count=number_slider)
series_2 = Series(Start=0, Step=division_2, Count=number_slider_2)
cylinder = Cylinder(Base=PlaneXY(20, 20, 0), Radius=R, Length=L)
repeat_data = RepeatData(Data=series_2, Length=number_slider)
construct_point = ConstructPoint(XCoordinate=repeat_data, YCoordinate=series, ZCoordinate=0)
evaluate_surface = EvaluateSurface(Surface=reparameterize(cylinder), Point=construct_point)  # -> Point, Normal, UDirection, VDirection, Frame

# ----
# Create grid
voxelsize = Slider(1, range=0..10)
height = Slider(40, range=0..200)
# Example 4: Voxelate surface / brep with attractor distance
X = Slider(40, range=0..100)
domain_box = DomainBox(Base=PlaneXY(0, 0, 0), X=X, Y=X, Z=height)
create_voxelgrid = CreateVoxelGrid(BoundingBox=domain_box, SizeX=voxelsize, SizeY=voxelsize, SizeZ=voxelsize)

interpolate = Interpolate(Vertices=evaluate_surface.Point, Degree=3, Periodic=False, KnotStyle=1)  # -> Curve, Length, Domain
voxelategeometry = VoxelateGeometry(Geometry=interpolate.Curve, VoxelGrid=create_voxelgrid, Distance=attractor_distance)
