# Grasshopper definition 06-voxelate-points.gh (Grasshopper 1.0.7)
# plug-ins: VoxelTools

# ----
# Create grid
voxelsize = Slider(1, range=0..10)
height = Slider(40, range=0..200)
# Example 4: Voxelate surface / brep with attractor distance
X = Slider(40, range=0..100)
domain_box = DomainBox(Base=PlaneXY(0, 0, 0), X=X, Y=X, Z=height)
create_voxelgrid = CreateVoxelGrid(BoundingBox=domain_box, SizeX=voxelsize, SizeY=voxelsize, SizeZ=voxelsize)

attractor_distance = Slider(10, range=0..10)
populate_3d = Populate3D(Region=domain_box, Count=100, Seed=1)
voxelategeometry = VoxelateGeometry(Geometry=populate_3d, VoxelGrid=create_voxelgrid, Distance=attractor_distance)
